# Grasshopper definition 251213_3dBinPacking.gh (Grasshopper 1.0.8)
# plug-ins: RhinoCodePluginGH

c_script = CSharpScript(Dir=".\voxels\")  # -> out, Log, Path; inputs Dir: String
# ---------- c_script: C# ----------
// Grasshopper Script Instance
#region Usings
using System;
using System.IO;
using System.Linq;
using System.Collections.Generic;
using Rhino;
using Rhino.Geometry;
using Grasshopper;
using Grasshopper.Kernel;
#endregion

public class Script_Instance : GH_ScriptInstance
{
  int STABLE_CHECKS = 3;
  int STABLE_INTERVAL_MS = 200;
  int STABLE_TIMEOUT_MS = 20000;

  int _count = 0;
  HashSet<string> _processed = new HashSet<string>(StringComparer.OrdinalIgnoreCase);

  string _lastPath = null;

  private void RunScript(object x, string Dir, ref object Log, ref object Path)
  {
    _count++;

    Log = "";
    Path = _lastPath;

    // ★ 監視ディレクトリを解決
    string watchDir = ResolveDirectory(Dir);

    if (string.IsNullOrWhiteSpace(watchDir))
    {
      Log = $"[{_count}] Directory path is empty.";
      return;
    }

    if (!Directory.Exists(watchDir))
    {
      Log = $"[{_count}] Watch dir not found:\n{watchDir}";
      return;
    }

    List<string> all;
    try
    {
      all = Directory.EnumerateFiles(watchDir, "*.3dm", SearchOption.TopDirectoryOnly)
                     .OrderBy(p => p, StringComparer.OrdinalIgnoreCase)
                     .ToList();
    }
    catch (Exception ex)
    {
      Log = $"[{_count}] Enumerate failed: {ex.Message}";
      return;
    }

    if (all.Count == 0)
    {
      Log = $"[{_count}] No .3dm files. (polling)";
      return;
    }

    string next = all.FirstOrDefault(p => !_processed.Contains(p));
    if (next == null)
    {
      Log = $"[{_count}] No new .3dm. processed={_processed.Count} total={all.Count}\nLastPath={_lastPath}";
      return;
    }

    if (!WaitUntilStableReadable(next, STABLE_CHECKS, STABLE_INTERVAL_MS, STABLE_TIMEOUT_MS))
    {
      Log = $"[{_count}] Waiting write finish...\n{next}\nLastPath={_lastPath}";
      return;
    }

    _processed.Add(next);

    _lastPath = next;
    Path = _lastPath;

    Log = $"[{_count}] New 3DM detected:\n{_lastPath}\nprocessed={_processed.Count} total={all.Count}";
  }

  // ★ Grasshopper ファイル基準で相対パスを解決
  string ResolveDirectory(string dir)
  {
    if (string.IsNullOrWhiteSpace(dir))
      return null;

    // 絶対パスならそのまま
    if (Path.IsPathRooted(dir))
      return Path.GetFullPath(dir);

    // 相対パス → Grasshopper ファイルの場所基準
    string ghPath = GrasshopperDocument?.FilePath;

    if (string.IsNullOrWhiteSpace(ghPath))
    {
      // 未保存の場合は Rhino の実行ディレクトリ基準
      return Path.GetFullPath(dir);
    }

    string ghDir = Path.GetDirectoryName(ghPath);
    return Path.GetFullPath(Path.Combine(ghDir, dir));
  }

  bool WaitUntilStableReadable(string path, int stableChecks, int intervalMs, int timeoutMs)
  {
    var start = DateTime.UtcNow;
    long lastSize = -1;
    int same = 0;

    while ((DateTime.UtcNow - start).TotalMilliseconds < timeoutMs)
    {
      try
      {
        var fi = new FileInfo(path);
        long size = fi.Length;

        using (File.Open(path, FileMode.Open, FileAccess.Read, FileShare.Read)) { }

        if (size == lastSize)
        {
          same++;
          if (same >= stableChecks) return true;
        }
        else
        {
          lastSize = size;
          same = 0;
        }
      }
      catch
      {
        same = 0;
      }

      System.Threading.Thread.Sleep(intervalMs);
    }
    return false;
  }
}
# ---------- end c_script ----------
c_script_2 = CSharpScript(P=c_script.Path)  # -> out, Boxes, Log; inputs P: String
# ---------- c_script_2: C# ----------
// Grasshopper Script Instance
#region Usings
using System;
using System.IO;
using System.Linq;
using System.Collections.Generic;

using Rhino;
using Rhino.Geometry;
using Rhino.FileIO;
#endregion

public class Script_Instance : GH_ScriptInstance
{
  string _lastPath = null;

  // ★最後に成功したBoxを保持（null出力しない / downstream安定）
  List<Box> _lastBoxes = new List<Box>();
  string _log = "";

  private void RunScript(string P, ref object Boxes, ref object Log)
  {
    // ★毎回nullにしない：常に保持値を出す
    Boxes = _lastBoxes;
    Log = _log;

    if (string.IsNullOrWhiteSpace(P))
    {
      _log = "No path. (keep last boxes)";
      Log = _log;
      return;
    }

    if (!File.Exists(P))
    {
      _log = "File not found. (keep last boxes)\n" + P;
      Log = _log;
      return;
    }

    // 同一パスで再実行しても更新しない（上書き検知したいならこの条件を変える）
    if (string.Equals(P, _lastPath, StringComparison.OrdinalIgnoreCase))
    {
      _log = "Same path (keep boxes):\n" + P;
      Log = _log;
      return;
    }

    try
    {
      var boxes = Load3dmAsBoxes_NoRhinoDoc(P);

      if (boxes == null || boxes.Count == 0)
        throw new Exception("No geometry found (no bounding boxes created).");

      // ★成功したらラッチ更新
      _lastBoxes = boxes;
      _lastPath = P;

      Boxes = _lastBoxes;
      _log = $"Loaded 3dm as Box list (bbox per object, no Rhino import)\nBoxes={boxes.Count}\n{P}";
      Log = _log;
    }
    catch (Exception ex)
    {
      _log = "Load failed (keep last boxes):\n" + ex.Message;
      Log = _log;
    }
  }

  // ------------------------------------------------------------
  // 3dm を RhinoDoc に Import せず、ファイルから直接読んで
  // 各オブジェクトの BoundingBox を Box として抽出
  // ------------------------------------------------------------
  List<Box> Load3dmAsBoxes_NoRhinoDoc(string path)
  {
    var model = File3dm.Read(path);
    if (model == null)
      throw new Exception("File3dm.Read failed.");

    var result = new List<Box>();

    foreach (var obj in model.Objects)
    {
      if (obj == null) continue;

      var geo = obj.Geometry;
      if (geo == null) continue;

      // オブジェクトのバウンディングボックス（ワールド座標）
      // true: accurate（計算コストは増えるが安全）
      BoundingBox bb = geo.GetBoundingBox(true);
      if (!bb.IsValid) continue;

      // BoundingBox -> Box（軸平行の直方体）
      // Box は Plane.WorldXY + intervals で作るのが確実
      var x = new Interval(bb.Min.X, bb.Max.X);
      var y = new Interval(bb.Min.Y, bb.Max.Y);
      var z = new Interval(bb.Min.Z, bb.Max.Z);
      var b = new Box(Plane.WorldXY, x, y, z);

      if (b.IsValid)
        result.Add(b);
    }

    return result;
  }
}
# ---------- end c_script_2 ----------
geo = Geometry(c_script_2.Boxes)
bbox = BoundingBox(Content=geo, Plane=PlaneXY(0, 0, 0), UnionBox=True)  # -> Box, Box_2
boxsidemaker = BoxSideMaker(B=bbox.Box)
pt = Point(Point(19943.25537, -5860.269467, 13235.29988))
brep_cp = BrepClosestPoint(Point=pt, Brep=boxsidemaker)  # -> Point, Normal, Distance
c_script_3 = CSharpScript(Dir=".\packList\")  # -> out, Log, Path; inputs Dir: String
# ---------- c_script_3: C# ----------
// Grasshopper Script Instance
#region Usings
using System;
using System.IO;
using System.Linq;
using System.Collections.Generic;
using Rhino;
using Rhino.Geometry;
using Grasshopper;
using Grasshopper.Kernel;
#endregion

public class Script_Instance : GH_ScriptInstance
{
  int STABLE_CHECKS = 3;
  int STABLE_INTERVAL_MS = 200;
  int STABLE_TIMEOUT_MS = 20000;

  int _count = 0;
  HashSet<string> _processed = new HashSet<string>(StringComparer.OrdinalIgnoreCase);

  string _lastPath = null;

  private void RunScript(object x, string Dir, ref object Log, ref object Path)
  {
    _count++;

    Log = "";
    Path = _lastPath;

    // ★ 監視ディレクトリを解決
    string watchDir = ResolveDirectory(Dir);

    if (string.IsNullOrWhiteSpace(watchDir))
    {
      Log = $"[{_count}] Directory path is empty.";
      return;
    }

    if (!Directory.Exists(watchDir))
    {
      Log = $"[{_count}] Watch dir not found:\n{watchDir}";
      return;
    }

    List<string> all;
    try
    {
      all = Directory.EnumerateFiles(watchDir, "*.json", SearchOption.TopDirectoryOnly)
                     .OrderBy(p => p, StringComparer.OrdinalIgnoreCase)
                     .ToList();
    }
    catch (Exception ex)
    {
      Log = $"[{_count}] Enumerate failed: {ex.Message}";
      return;
    }

    if (all.Count == 0)
    {
      Log = $"[{_count}] No .json files. (polling)";
      return;
    }

    string next = all.FirstOrDefault(p => !_processed.Contains(p));
    if (next == null)
    {
      Log = $"[{_count}] No new .json. processed={_processed.Count} total={all.Count}\nLastPath={_lastPath}";
      return;
    }

    if (!WaitUntilStableReadable(next, STABLE_CHECKS, STABLE_INTERVAL_MS, STABLE_TIMEOUT_MS))
    {
      Log = $"[{_count}] Waiting write finish...\n{next}\nLastPath={_lastPath}";
      return;
    }

    _processed.Add(next);

    _lastPath = next;
    Path = _lastPath;

    Log = $"[{_count}] New JSON detected:\n{_lastPath}\nprocessed={_processed.Count} total={all.Count}";
  }

  // ★ Grasshopper ファイル基準で相対パスを解決
  string ResolveDirectory(string dir)
  {
    if (string.IsNullOrWhiteSpace(dir))
      return null;

    // 絶対パスならそのまま
    if (Path.IsPathRooted(dir))
      return Path.GetFullPath(dir);

    // 相対パス → Grasshopper ファイルの場所基準
    string ghPath = GrasshopperDocument?.FilePath;

    if (string.IsNullOrWhiteSpace(ghPath))
    {
      // 未保存の場合は Rhino の実行ディレクトリ基準
      return Path.GetFullPath(dir);
    }

    string ghDir = Path.GetDirectoryName(ghPath);
    return Path.GetFullPath(Path.Combine(ghDir, dir));
  }

  bool WaitUntilStableReadable(string path, int stableChecks, int intervalMs, int timeoutMs)
  {
    var start = DateTime.UtcNow;
    long lastSize = -1;
    int same = 0;

    while ((DateTime.UtcNow - start).TotalMilliseconds < timeoutMs)
    {
      try
      {
        var fi = new FileInfo(path);
        long size = fi.Length;

        using (File.Open(path, FileMode.Open, FileAccess.Read, FileShare.Read)) { }

        if (size == lastSize)
        {
          same++;
          if (same >= stableChecks) return true;
        }
        else
        {
          lastSize = size;
          same = 0;
        }
      }
      catch
      {
        same = 0;
      }

      System.Threading.Thread.Sleep(intervalMs);
    }
    return false;
  }
}
# ---------- end c_script_3 ----------
devec = DeconstructVector(Vector=brep_cp.Normal)  # -> XComponent, YComponent, ZComponent
vec = VectorXYZ(XComponent=devec.XComponent, YComponent=devec.YComponent, ZComponent=0)  # -> Vector, Length
number_slider = Slider(1000, range=0..1000)
c_script_4 = CSharpScript(P=c_script_3.Path)  # -> out, JsonText, Log; inputs P: String, ForceReload: Boolean
# ---------- c_script_4: C# ----------
// Grasshopper Script Instance
#region Usings
using System;
using System.IO;
using System.Text;
#endregion

public class Script_Instance : GH_ScriptInstance
{
  string _lastPath = null;
  DateTime _lastWrite = DateTime.MinValue;

  // ★最後に成功したJSON文字列を保持（null出力しない / downstream安定）
  string _lastJson = "";
  string _log = "";

  private void RunScript(
		string P,
		bool ForceReload,
		ref object JsonText,
		ref object Log)
  {
    // 常に保持値を出す（下流がnullで壊れない）
    JsonText = _lastJson;
    Log = _log;

    if (string.IsNullOrWhiteSpace(P))
    {
      _log = "No path. (keep last json)";
      Log = _log;
      return;
    }

    // 相対パスが来ても一応絶対化（GHファイル未保存ならカレント基準）
    string path = P;
    try
    {
      if (!Path.IsPathRooted(path))
        path = Path.GetFullPath(path);
    }
    catch { /* ignore */ }

    if (!File.Exists(path))
    {
      _log = "File not found. (keep last json)\n" + path;
      Log = _log;
      return;
    }

    // 更新検知（同一パスでも中身が変わったら読み直す）
    DateTime wt;
    try { wt = File.GetLastWriteTimeUtc(path); }
    catch { wt = DateTime.MinValue; }

    bool samePath = string.Equals(path, _lastPath, StringComparison.OrdinalIgnoreCase);
    bool sameWrite = (wt == _lastWrite);

    if (!ForceReload && samePath && sameWrite)
    {
      _log = "Same path & same timestamp (keep json):\n" + path;
      Log = _log;
      return;
    }

    try
    {
      // UTF-8(BOMあり/なし)を強めに吸収
      string json = ReadAllTextUtf8Robust(path);

      if (string.IsNullOrWhiteSpace(json))
        throw new Exception("JSON file is empty.");

      // 成功したらラッチ更新
      _lastJson = json;
      _lastPath = path;
      _lastWrite = wt;

      JsonText = _lastJson;
      _log = $"Loaded JSON\nChars={json.Length}\nLastWriteUtc={wt:O}\n{path}";
      Log = _log;
    }
    catch (Exception ex)
    {
      _log = "Load failed (keep last json):\n" + ex.Message;
      Log = _log;
    }
  }

  string ReadAllTextUtf8Robust(string path)
  {
    // まずは普通に ReadAllText（OS既定で失敗する場合があるので）
    // → バイトで読んで UTF8 を明示して decode する方が安定
    var bytes = File.ReadAllBytes(path);

    // UTF-8 BOM (EF BB BF) を除去
    if (bytes.Length >= 3 && bytes[0] == 0xEF && bytes[1] == 0xBB && bytes[2] == 0xBF)
      return Encoding.UTF8.GetString(bytes, 3, bytes.Length - 3);

    return Encoding.UTF8.GetString(bytes);
  }
}
# ---------- end c_script_4 ----------
vec_2 = Vector(vec.Vector)
rev = Reverse(Vector=vec_2)
c_script_5 = CSharpScript(ContainerVox=geo, VoxelSize=number_slider)  # -> out, KeysText, UniqueCount, DuplicateCount, flatten(UniqueBoxes); inputs VoxelSize: Double
# ---------- c_script_5: C# ----------
// Grasshopper C# Script Component
// Inputs:
//   ContainerVox (object) : Box のフラットList / Tree / IEnumerable を許容
//   VoxelSize   (double) : ボクセル1辺サイズ（Box中心の量子化に使用）
//
// Outputs:
//   KeysText    (List<string>) : CellKey を文字列化した一覧（確認用）
//   UniqueCount (int)          : ユニークセル数
//   DuplicateCount (int)       : 重複として弾かれた数
//   UniqueBoxes (List<Box>)    : ユニークセルに対応する Box（可視化用）

#region Usings
using System;
using System.Linq;
using System.Collections;
using System.Collections.Generic;

using Rhino;
using Rhino.Geometry;

using Grasshopper;
using Grasshopper.Kernel;
using Grasshopper.Kernel.Data;
using Grasshopper.Kernel.Types;
#endregion

public class Script_Instance : GH_ScriptInstance
{
  #region CellKey

  struct CellKey : IEquatable<CellKey>
  {
    public int x, y, z;

    public CellKey(int x, int y, int z)
    {
      this.x = x; this.y = y; this.z = z;
    }

    public bool Equals(CellKey other)
    {
      return x == other.x && y == other.y && z == other.z;
    }

    public override bool Equals(object obj)
    {
      return obj is CellKey other && Equals(other);
    }

    public override int GetHashCode()
    {
      unchecked
      {
        return (x * 73856093) ^ (y * 19349663) ^ (z * 83492791);
      }
    }

    public override string ToString()
    {
      return string.Format("({0},{1},{2})", x, y, z);
    }
  }

  static CellKey ToCellKey(Point3d p, double voxelSize)
  {
    int ix = (int)Math.Round(p.X / voxelSize);
    int iy = (int)Math.Round(p.Y / voxelSize);
    int iz = (int)Math.Round(p.Z / voxelSize);
    return new CellKey(ix, iy, iz);
  }

  #endregion

  #region Normalize Input -> List<Box>

  List<Box> NormalizeBoxes(object input)
  {
    var boxes = new List<Box>();
    if (input == null) return boxes;

    // 1) すでに List<Box>
    var lb = input as List<Box>;
    if (lb != null) { boxes.AddRange(lb); return boxes; }

    // 2) IEnumerable<Box>
    var ieBox = input as IEnumerable<Box>;
    if (ieBox != null) { boxes.AddRange(ieBox); return boxes; }

    // 3) DataTree（object / IGH_Goo の可能性）
    var treeObj = input as IGH_Structure;
    if (treeObj != null)
    {
      // ここは型が曖昧なので、全要素を Goo として舐める
      // （Script Component の入力が Tree Access のときに通ることが多い）
      foreach (var path in treeObj.Paths)
      {
        var branch = treeObj.get_Branch(path);
        if (branch == null) continue;

        foreach (var o in branch)
        {
          if (o == null) continue;
          Box b;
          if (TryCoerceBox(o, out b))
            boxes.Add(b);
        }
      }
      return boxes;
    }

    // 4) IEnumerable（中身が Box / GH_Box / object）
    var ie = input as IEnumerable;
    if (ie != null)
    {
      foreach (var o in ie)
      {
        if (o == null) continue;
        Box b;
        if (TryCoerceBox(o, out b))
          boxes.Add(b);
      }
      return boxes;
    }

    // 5) 単体 Box / GH_Box / object
    {
      Box b;
      if (TryCoerceBox(input, out b))
        boxes.Add(b);
    }

    return boxes;
  }

  bool TryCoerceBox(object obj, out Box b)
{
  b = Box.Unset;
  if (obj == null) return false;

  if (obj is Box)
  {
    b = (Box)obj;
    return b.IsValid;
  }

  // GH_Box revealed directly
  var ghb = obj as GH_Box;
  if (ghb != null)
  {
    b = ghb.Value;
    return b.IsValid;
  }

  // IGH_Goo からの Cast（★ out を使う）
  var goo = obj as IGH_Goo;
  if (goo != null)
  {
    GH_Box tmp; // ★ ここは未初期化でOK
    if (goo.CastTo(out tmp)) // ★ ref → out に変更
    {
      b = tmp.Value;
      return b.IsValid;
    }
  }

  return false;
}


  #endregion

  private void RunScript(
		object ContainerVox,
		double VoxelSize,
		ref object KeysText,
		ref object UniqueCount,
		ref object DuplicateCount,
		ref object UniqueBoxes)
  {
    if (VoxelSize <= 0)
    {
      KeysText = new List<string>();
      UniqueCount = 0;
      DuplicateCount = 0;
      UniqueBoxes = new List<Box>();
      Print("VoxelSize must be > 0");
      return;
    }

    // 入力を Box のフラットリストへ
    var boxes = NormalizeBoxes(ContainerVox);

    var containerSet = new HashSet<CellKey>();
    var keyToBox = new Dictionary<CellKey, Box>();

    int dup = 0;

    foreach (var bx in boxes)
    {
      if (!bx.IsValid) continue;

      var key = ToCellKey(bx.Center, VoxelSize);

      if (!containerSet.Add(key))
      {
        dup++;
        continue;
      }

      // 可視化用に代表Boxを保持（同じセルに複数Boxがあっても最初の1個）
      keyToBox[key] = bx;
    }

    // Outputs
    var keysText = new List<string>(containerSet.Count);
    foreach (var k in containerSet) keysText.Add(k.ToString());

    KeysText = keysText;
    UniqueCount = containerSet.Count;
    DuplicateCount = dup;
    UniqueBoxes = keyToBox.Values.ToList();

    Print(string.Format("Input Boxes: {0}", boxes.Count));
    Print(string.Format("Unique Cells: {0}", containerSet.Count));
    Print(string.Format("Duplicates: {0}", dup));
  }
}
# ---------- end c_script_5 ----------
c_script_6 = CSharpScript(JsonText=c_script_4.JsonText, VoxelSize_mm=number_slider)  # -> out, ItemsDebug, VariantsTree, VariantsSizeTree, SortedIds, OrderTree, NameOrderTree; inputs JsonText: String, VoxelSize_mm: Double
# ---------- c_script_6: C# ----------
// Grasshopper Script Instance
#region Usings
using System;
using System.Linq;
using System.Collections.Generic;
using System.Text.Json;

using Rhino;
using Rhino.Geometry;

using Grasshopper;
using Grasshopper.Kernel.Data;
#endregion

public class Script_Instance : GH_ScriptInstance
{
  // -------- CellKey（ローカル形状用）--------
  struct CellKey : IEquatable<CellKey>
  {
    public int x, y, z;
    public CellKey(int x, int y, int z){ this.x=x; this.y=y; this.z=z; }
    public bool Equals(CellKey o) => x==o.x && y==o.y && z==o.z;
    public override bool Equals(object obj) => obj is CellKey o && Equals(o);
    public override int GetHashCode(){ unchecked { return (x*73856093) ^ (y*19349663) ^ (z*83492791); } }
    public override string ToString() => $"({x},{y},{z})";
  }

  class Root { public List<ItemSpec> items { get; set; } }

  class ItemSpec
  {
    public string id { get; set; }
    public double x_mm { get; set; }
    public double y_mm { get; set; }
    public double z_mm { get; set; }
    public int order { get; set; }
    public double weight_kg { get; set; }
    public bool fragile { get; set; }
    public bool rot_xy { get; set; }
  }

  class Variant
  {
    public string id;
    public int order;
    public bool fragile;
    public double weight_kg;
    public int nx, ny, nz;
    public List<CellKey> localKeys;
    public string rotLabel;
  }

  int ToN(double mm, double voxMm) => Math.Max(1, (int)Math.Ceiling(mm / voxMm));

  List<CellKey> BuildLocalKeys(int nx, int ny, int nz)
  {
    var list = new List<CellKey>(nx*ny*nz);
    for(int ix=0; ix<nx; ix++)
      for(int iy=0; iy<ny; iy++)
        for(int iz=0; iz<nz; iz++)
          list.Add(new CellKey(ix,iy,iz));
    return list;
  }

  private void RunScript(
		string JsonText,
		double VoxelSize_mm,
		ref object ItemsDebug,
		ref object VariantsTree,
		ref object VariantsSizeTree,
		ref object SortedIds,
		ref object OrderTree,
		ref object NameOrderTree)
  {
    ItemsDebug = new List<string>();
    VariantsTree = null;
    VariantsSizeTree = null;
    SortedIds = new List<string>();
    OrderTree = null;
    NameOrderTree = null;

    if (VoxelSize_mm <= 0) { Print("VoxelSize_mm must be > 0"); return; }
    if (string.IsNullOrWhiteSpace(JsonText)) { Print("JsonText is empty"); return; }

    Root root = null;
    try
    {
      var options = new JsonSerializerOptions { PropertyNameCaseInsensitive = true };
      root = JsonSerializer.Deserialize<Root>(JsonText, options);
    }
    catch (Exception ex)
    {
      Print("JSON parse failed: " + ex.Message);
      return;
    }

    if (root == null || root.items == null || root.items.Count == 0)
    {
      Print("No items found in JSON.");
      return;
    }

    // order 昇順 = SortedIds の順番
    var itemsSorted = root.items.OrderBy(i => i.order).ToList();

    var dbg = new List<string>();
    var ids = new List<string>();

    var tree = new DataTree<string>();         // {itemIndex;variantIndex} -> localKeys string
    var sizeTree = new DataTree<Vector3d>();   // {itemIndex;variantIndex} -> (nx,ny,nz)

    var orderTree = new DataTree<int>();       // {itemIndex} -> order
    var nameOrderTree = new DataTree<int>();   // {itemIndex} -> suffix番号（ここでは order を採用）

    for (int i = 0; i < itemsSorted.Count; i++)
    {
      var it = itemsSorted[i];
      ids.Add(it.id);

      int nx = ToN(it.x_mm, VoxelSize_mm);
      int ny = ToN(it.y_mm, VoxelSize_mm);
      int nz = ToN(it.z_mm, VoxelSize_mm);

      dbg.Add($"[{i}] id={it.id} order={it.order} size(mm)=({it.x_mm},{it.y_mm},{it.z_mm}) -> cells=({nx},{ny},{nz}) rot_xy={it.rot_xy} fragile={it.fragile} weight={it.weight_kg}kg");

      // ここが「SortedIdsに対応した order のツリー」
      var pItem = new GH_Path(i);
      orderTree.Add(it.order, pItem);

      // OBJ suffix 用：3桁 D3 にしたいなら export 側で ToString("D3")
      // ここでは order をそのまま入れる（必要なら i+1 などに変えてOK）
      nameOrderTree.Add(it.order, pItem);

      // 回転バリアント生成
      var variants = new List<Variant>();

      variants.Add(new Variant{
        id=it.id, order=it.order, fragile=it.fragile, weight_kg=it.weight_kg,
        nx=nx, ny=ny, nz=nz, localKeys=BuildLocalKeys(nx,ny,nz), rotLabel="xyz"
      });

      if (it.rot_xy && !(nx==ny))
      {
        variants.Add(new Variant{
          id=it.id, order=it.order, fragile=it.fragile, weight_kg=it.weight_kg,
          nx=ny, ny=nx, nz=nz, localKeys=BuildLocalKeys(ny,nx,nz), rotLabel="yxz"
        });
      }

      for (int v = 0; v < variants.Count; v++)
      {
        var path = new GH_Path(i, v);

        foreach (var ck in variants[v].localKeys)
          tree.Add(ck.ToString(), path);

        sizeTree.Add(new Vector3d(variants[v].nx, variants[v].ny, variants[v].nz), path);
      }
    }

    ItemsDebug = dbg;
    SortedIds = ids;
    VariantsTree = tree;
    VariantsSizeTree = sizeTree;

    OrderTree = orderTree;
    NameOrderTree = nameOrderTree;
  }
}
# ---------- end c_script_6 ----------
c_script_7 = CSharpScript(
    ContainerVox=c_script_5.UniqueBoxes,
    VoxelSize=number_slider,
    LoadVec=rev,
    SortedIds=c_script_6.SortedIds,
    VariantsSizeTree=c_script_6.VariantsSizeTree)  # -> out, PlacedOriginPtsTree, PlacedVoxTree, Success, RemainingFreeBoxes, Debug; inputs ContainerVox: list of Box, VoxelSize: Double, LoadVec: Vector3d, DoorAtMax: Boolean, SortedIds: list of String, VariantsSizeTree: tree of Vector3d
# ---------- c_script_7: C# ----------
// Grasshopper C# Script Component
// Greedy voxel packing: bottom-up (z asc), back-to-front (far from door -> near door)
// Items are loaded in reverse of unload order (SortedIds is unload asc => load desc)

// Inputs:
//   object       ContainerVox
//   double       VoxelSize
//   Vector3d     LoadVec
//   bool         DoorAtMax
//   List<string> SortedIds              // from JSON component (order asc / unload order)
//   object       VariantsSizeTree       // DataTree<Vector3d> {itemIndex;variantIndex} => (nx,ny,nz)
//
// Outputs:
//   object       PlacedOriginPtsTree    // DataTree<Point3d> {itemIndex}
//   object       PlacedVoxTree          // DataTree<Box>     {itemIndex}
//   List<bool>   Success
//   List<Box>    RemainingFreeBoxes
//   List<string> Debug

#region Usings
using System;
using System.Linq;
using System.Collections;
using System.Collections.Generic;

using Rhino;
using Rhino.Geometry;

using Grasshopper;
using Grasshopper.Kernel;
using Grasshopper.Kernel.Data;
using Grasshopper.Kernel.Types;
#endregion

public class Script_Instance : GH_ScriptInstance
{
  // -------- CellKey --------
  struct CellKey : IEquatable<CellKey>
  {
    public int x, y, z;
    public CellKey(int x, int y, int z){ this.x=x; this.y=y; this.z=z; }
    public bool Equals(CellKey o) => x==o.x && y==o.y && z==o.z;
    public override bool Equals(object obj) => obj is CellKey o && Equals(o);
    public override int GetHashCode(){ unchecked { return (x*73856093) ^ (y*19349663) ^ (z*83492791); } }
    public override string ToString() => $"({x},{y},{z})";
  }

  static CellKey ToCellKey(Point3d p, double s)
  {
    return new CellKey(
      (int)Math.Round(p.X / s),
      (int)Math.Round(p.Y / s),
      (int)Math.Round(p.Z / s)
    );
  }

  // -------- Normalize ContainerVox -> List<Box> --------
  List<Box> NormalizeBoxes(object input)
  {
    var boxes = new List<Box>();
    if (input == null) return boxes;

    var lb = input as List<Box>;
    if (lb != null) { boxes.AddRange(lb); return boxes; }

    var ieBox = input as IEnumerable<Box>;
    if (ieBox != null) { boxes.AddRange(ieBox); return boxes; }

    var treeObj = input as IGH_Structure;
    if (treeObj != null)
    {
      foreach (var path in treeObj.Paths)
      {
        var branch = treeObj.get_Branch(path);
        if (branch == null) continue;
        foreach (var o in branch)
        {
          Box b;
          if (TryCoerceBox(o, out b)) boxes.Add(b);
        }
      }
      return boxes;
    }

    var ie = input as IEnumerable;
    if (ie != null)
    {
      foreach (var o in ie)
      {
        Box b;
        if (TryCoerceBox(o, out b)) boxes.Add(b);
      }
      return boxes;
    }

    {
      Box b;
      if (TryCoerceBox(input, out b)) boxes.Add(b);
    }
    return boxes;
  }

  bool TryCoerceBox(object obj, out Box b)
  {
    b = Box.Unset;
    if (obj == null) return false;

    if (obj is Box)
    {
      b = (Box)obj;
      return b.IsValid;
    }

    var ghb = obj as GH_Box;
    if (ghb != null)
    {
      b = ghb.Value;
      return b.IsValid;
    }

    var goo = obj as IGH_Goo;
    if (goo != null)
    {
      GH_Box tmp;
      if (goo.CastTo(out tmp))
      {
        b = tmp.Value;
        return b.IsValid;
      }
    }
    return false;
  }

  // -------- VariantsSizeTree -> DataTree<Vector3d> --------
  DataTree<Vector3d> CoerceVector3dTree(object treeObj)
  {
    // 期待：DataTree<Vector3d> か DataTree<GH_Vector> / IGH_Structure
    var vt = treeObj as DataTree<Vector3d>;
    if (vt != null) return vt;

    var ghvTree = treeObj as IGH_Structure;
    if (ghvTree == null) return null;

    var outTree = new DataTree<Vector3d>();
    foreach (var path in ghvTree.Paths)
    {
      var br = ghvTree.get_Branch(path);
      if (br == null) continue;

      foreach (var o in br)
      {
        if (o == null) continue;

        // GH_Vector
        var ghv = o as GH_Vector;
        if (ghv != null) { outTree.Add(ghv.Value, path); continue; }

        // Vector3d
        if (o is Vector3d) { outTree.Add((Vector3d)o, path); continue; }

        // IGH_Goo cast
        var goo = o as IGH_Goo;
        if (goo != null)
        {
          GH_Vector tmp;
          if (goo.CastTo(out tmp)) outTree.Add(tmp.Value, path);
        }
      }
    }
    return outTree;
  }

  // -------- Packing helpers --------
  double DotScore(CellKey k, Vector3d vUnit, double s)
  {
    // セル中心座標（ワールド）を使って投影スコアを作る
    var p = new Point3d(k.x * s, k.y * s, k.z * s);
    return Vector3d.Multiply((Vector3d)p, vUnit);
  }

  // Forward(=LoadVec) と WorldUp から「ドアから見た Right」を作る
    bool BuildDoorBasis(Vector3d forwardUnit, out Vector3d rightUnit, out Vector3d upUnit)
    {
    // 基本は World Z を Up にする
    upUnit = Vector3d.ZAxis;

    // forward がほぼ Z と平行だと Cross が死ぬので退避
    double parallel = Math.Abs(Vector3d.Multiply(forwardUnit, upUnit)); // |dot|
    if (parallel > 0.98) // ほぼ平行
        upUnit = Vector3d.XAxis;

    // Right = Up × Forward（Forwardを見たときの右）
    rightUnit = Vector3d.CrossProduct(upUnit, forwardUnit);
    if (!rightUnit.Unitize())
        return false;

    // 直交性を強めたいなら Up を作り直す（任意）
    upUnit = Vector3d.CrossProduct(forwardUnit, rightUnit);
    upUnit.Unitize();

    return true;
    }

    // 任意方向への投影スコア（セル中心）
    double DotScoreDir(CellKey k, Vector3d dirUnit, double s)
    {
    var p = new Point3d(k.x * s, k.y * s, k.z * s);
    return Vector3d.Multiply((Vector3d)p, dirUnit); // dot
    }

  IEnumerable<CellKey> EnumerateLocalKeys(int nx, int ny, int nz)
  {
    for (int ix=0; ix<nx; ix++)
      for (int iy=0; iy<ny; iy++)
        for (int iz=0; iz<nz; iz++)
          yield return new CellKey(ix,iy,iz);
  }

  bool CanPlace(CellKey origin, int nx, int ny, int nz, HashSet<CellKey> free)
  {
    foreach (var lk in EnumerateLocalKeys(nx,ny,nz))
    {
      var wk = new CellKey(origin.x + lk.x, origin.y + lk.y, origin.z + lk.z);
      if (!free.Contains(wk)) return false;
    }
    return true;
  }

  void CommitPlace(int itemIndex, CellKey origin, int nx, int ny, int nz,
                   HashSet<CellKey> free,
                   Dictionary<CellKey, Box> keyToBox,
                   Box templateBox,
                   double voxelSize,
                   DataTree<Point3d> placedPtsTree,
                   DataTree<Box> placedVoxTree,
                   List<string> dbg)
  {
    var path = new GH_Path(itemIndex);

    // 原点セル中心
    var originCenter = new Point3d(origin.x * voxelSize, origin.y * voxelSize, origin.z * voxelSize);
    placedPtsTree.Add(originCenter, path);

    int count = 0;

    foreach (var lk in EnumerateLocalKeys(nx,ny,nz))
    {
      var wk = new CellKey(origin.x + lk.x, origin.y + lk.y, origin.z + lk.z);

      // freeから削除（占有）
      free.Remove(wk);

      // Box を作る：コンテナ由来の代表Boxが取れればそれを使い、無ければ template を中心移動
      Box b;
      if (keyToBox.TryGetValue(wk, out b) && b.IsValid)
      {
        placedVoxTree.Add(b, path);
      }
      else
      {
        // フォールバック：templateBoxを中心に合わせて平行移動
        var c = new Point3d(wk.x * voxelSize, wk.y * voxelSize, wk.z * voxelSize);
        var xform = Transform.Translation(c - templateBox.Center);
        var bb = templateBox;
        bb.Transform(xform);
        placedVoxTree.Add(bb, path);
      }
      count++;
    }

    dbg.Add($"Placed itemIndex={itemIndex} origin={origin} size=({nx},{ny},{nz}) cells={count}");
  }

  private void RunScript(
		List<Box> ContainerVox,
		double VoxelSize,
		Vector3d LoadVec,
		bool DoorAtMax,
		List<string> SortedIds,
		DataTree<Vector3d> VariantsSizeTree,
		ref object PlacedOriginPtsTree,
		ref object PlacedVoxTree,
		ref object Success,
		ref object RemainingFreeBoxes,
		ref object Debug)
  {
    var dbg = new List<string>();
    Debug = dbg;

    PlacedOriginPtsTree = null;
    PlacedVoxTree = null;
    Success = new List<bool>();
    RemainingFreeBoxes = new List<Box>();

    if (VoxelSize <= 0) { dbg.Add("VoxelSize must be > 0"); return; }

    if (SortedIds == null || SortedIds.Count == 0)
    {
      dbg.Add("SortedIds is empty. (use JSON component output)");
      return;
    }

    var sizeTree = CoerceVector3dTree(VariantsSizeTree);
    if (sizeTree == null || sizeTree.Paths.Count == 0)
    {
      dbg.Add("VariantsSizeTree is invalid/empty. (use JSON component VariantsSizeTree output)");
      return;
    }

    // コンテナ vox 正規化
    var boxes = NormalizeBoxes(ContainerVox).Where(b => b.IsValid).ToList();
    if (boxes.Count == 0) { dbg.Add("ContainerVox is empty/invalid."); return; }

    // LoadVec unitize
    var v = LoadVec;
    if (!v.Unitize()) { dbg.Add("LoadVec is zero vector."); return; }

    Vector3d right;
    Vector3d up;
    if (!BuildDoorBasis(v, out right, out up))
    {
    dbg.Add("Failed to build door basis (right/up).");
    return;
    }

    // コンテナのユニークセルを構築（keyToBoxも作る）
    var containerAll = new HashSet<CellKey>();
    var keyToBox = new Dictionary<CellKey, Box>();

    foreach (var bx in boxes)
    {
      var k = ToCellKey(bx.Center, VoxelSize);
      if (containerAll.Add(k))
      {
        keyToBox[k] = bx; // 代表
      }
    }

    // 空きセル = コンテナ全セル
    var free = new HashSet<CellKey>(containerAll);

    // 可視化用テンプレBox（向きやサイズを継承）
    var templateBox = keyToBox.Values.FirstOrDefault(b => b.IsValid);
    if (!templateBox.IsValid)
    {
      templateBox = boxes[0];
    }

    // 候補セル順序（下→上、奥→手前）
    // DoorAtMax=true => ドアが dot最大側 => 奥は dot最小側（昇順が奥→手前）
    // DoorAtMax=false => ドアが dot最小側 => 奥は dot最大側（降順が奥→手前）
    Func<CellKey, double> forwardScoreFn = (k) => DotScoreDir(k, v, VoxelSize);      // 奥行
    Func<CellKey, double> rightScoreFn   = (k) => DotScoreDir(k, right, VoxelSize);  // 左右

    var candidates = free.ToList();
    candidates.Sort((a,b) =>
    {
    // 1) back-to-front (far from door first) : 奥→手前（最優先）
    double fa = forwardScoreFn(a);
    double fb = forwardScoreFn(b);
    int cf = DoorAtMax ? fa.CompareTo(fb) : fb.CompareTo(fa); // 奥→手前
    if (cf != 0) return cf;

    // 2) left-to-right from the door viewpoint : 左→右（次優先）
    double ra = rightScoreFn(a);
    double rb = rightScoreFn(b);
    int cr = ra.CompareTo(rb); // 昇順＝左→右
    if (cr != 0) return cr;

    // 3) z asc (bottom-up) : 下→上（最後）
    int cz = a.z.CompareTo(b.z);
    if (cz != 0) return cz;

    // 4) 最後のタイブレーク（安定化用）
    int cx = a.x.CompareTo(b.x); if (cx != 0) return cx;
    return a.y.CompareTo(b.y);
    });


    dbg.Add($"Container unique cells={containerAll.Count}, candidates={candidates.Count}");

    // 荷物は「荷下ろし順の逆」から積む（奥から積む）
    // SortedIds: order asc（先に降ろす） => load order = reverse
    int nItems = SortedIds.Count;
    var success = new List<bool>(nItems);

    var placedPtsTree = new DataTree<Point3d>();
    var placedVoxTree = new DataTree<Box>();

    for (int itemIndexAsc = 0; itemIndexAsc < nItems; itemIndexAsc++)
      success.Add(false);

    for (int loadRank = 0; loadRank < nItems; loadRank++)
    {
      int itemIndex = (nItems - 1) - loadRank; // reverse index
      string id = SortedIds[itemIndex];

      // その itemIndex の variants を sizeTree から読む
      // sizeTree path: {itemIndex; variantIndex}
      // まず variantIndex を列挙
      var variantSizes = new List<Tuple<int,int,int,int>>(); // (variantIndex,nx,ny,nz)

      // sizeTree.Paths を走査して一致pathだけ拾う（確実性優先）
      foreach (var path in sizeTree.Paths)
      {
        if (path.Indices.Length < 2) continue;
        if (path.Indices[0] != itemIndex) continue;

        int vIndex = path.Indices[1];
        var br = sizeTree.Branch(path);
        if (br == null || br.Count == 0) continue;

        var s3 = br[0];
        int nx = Math.Max(1, (int)Math.Round(s3.X));
        int ny = Math.Max(1, (int)Math.Round(s3.Y));
        int nz = Math.Max(1, (int)Math.Round(s3.Z));
        variantSizes.Add(Tuple.Create(vIndex,nx,ny,nz));
      }

      if (variantSizes.Count == 0)
      {
        dbg.Add($"[FAIL] itemIndex={itemIndex} id={id} : no variants found in tree");
        continue;
      }

      // variantIndex 昇順で試す（まず標準姿勢、次に回転姿勢）
      variantSizes = variantSizes.OrderBy(t => t.Item1).ToList();

      bool placed = false;

      foreach (var varT in variantSizes)
      {
        int vIndex = varT.Item1;
        int nx = varT.Item2, ny = varT.Item3, nz = varT.Item4;

        // candidates を先頭からスキャンし、置ける最初の場所に置く
        for (int ci = 0; ci < candidates.Count; ci++)
        {
          var origin = candidates[ci];

          if (!CanPlace(origin, nx, ny, nz, free))
            continue;

          // 置く
          CommitPlace(itemIndex, origin, nx, ny, nz, free, keyToBox, templateBox, VoxelSize,
                      placedPtsTree, placedVoxTree, dbg);

          success[itemIndex] = true;
          placed = true;
          break;
        }

        if (placed)
        {
          dbg.Add($"OK itemIndex={itemIndex} id={id} variant={vIndex}");
          break;
        }
      }

      if (!placed)
      {
        dbg.Add($"[FAIL] itemIndex={itemIndex} id={id} : no feasible placement");
      }

      // free が減っているので candidates も更新（簡易に作り直し）
      candidates = free.ToList();
        candidates.Sort((a,b) =>
        {
        // 1) back-to-front (far from door first) : 奥→手前（最優先）
        double fa = forwardScoreFn(a);
        double fb = forwardScoreFn(b);
        int cf = DoorAtMax ? fa.CompareTo(fb) : fb.CompareTo(fa); // 奥→手前
        if (cf != 0) return cf;

        // 2) left-to-right from the door viewpoint : 左→右（次優先）
        double ra = rightScoreFn(a);
        double rb = rightScoreFn(b);
        int cr = ra.CompareTo(rb); // 昇順＝左→右
        if (cr != 0) return cr;

        // 3) z asc (bottom-up) : 下→上（最後）
        int cz = a.z.CompareTo(b.z);
        if (cz != 0) return cz;

        // 4) 最後のタイブレーク（安定化用）
        int cx = a.x.CompareTo(b.x); if (cx != 0) return cx;
        return a.y.CompareTo(b.y);
        });
    }

    // 残り空きBox
    var freeBoxes = new List<Box>(free.Count);
    foreach (var k in free)
    {
      Box b;
      if (keyToBox.TryGetValue(k, out b) && b.IsValid)
      {
        freeBoxes.Add(b);
      }
      else
      {
        var c = new Point3d(k.x * VoxelSize, k.y * VoxelSize, k.z * VoxelSize);
        var xform = Transform.Translation(c - templateBox.Center);
        var bb = templateBox;
        bb.Transform(xform);
        freeBoxes.Add(bb);
      }
    }

    PlacedOriginPtsTree = placedPtsTree;
    PlacedVoxTree = placedVoxTree;
    Success = success;
    RemainingFreeBoxes = freeBoxes;

    dbg.Add($"Done. Success={success.Count(x=>x)}/{success.Count}, FreeCells={free.Count}");
  }
}
# ---------- end c_script_7 ----------
geo_2 = Geometry(c_script_7.PlacedVoxTree)
c_script_8 = CSharpScript(B=geo_2, NameOrder=c_script_6.NameOrderTree, pathObj=".\baggage\", run=Toggle(True))  # -> out, okObj, ok3dm; inputs B: tree of Box, NameOrder: tree of Int32, pathObj: String, path3dm: String, run: Boolean
# ---------- c_script_8: C# ----------
// Grasshopper Script Instance
#region Usings
using System;
using System.Linq;
using System.Collections;
using System.Collections.Generic;
using System.IO;

using Rhino;
using Rhino.Geometry;
using Rhino.FileIO;

using Grasshopper;
using Grasshopper.Kernel;
using Grasshopper.Kernel.Data;
using Grasshopper.Kernel.Types;
#endregion

public class Script_Instance : GH_ScriptInstance
{
  #region Utility

  string GetGhBaseDir()
  {
    var ghPath = GrasshopperDocument != null ? GrasshopperDocument.FilePath : null;
    if (!string.IsNullOrWhiteSpace(ghPath))
      return Path.GetDirectoryName(ghPath);

    return Environment.GetFolderPath(Environment.SpecialFolder.DesktopDirectory);
  }

  string ResolveGhRelativePath(string p)
  {
    if (string.IsNullOrWhiteSpace(p)) return null;
    if (Path.IsPathRooted(p)) return p;
    return Path.GetFullPath(Path.Combine(GetGhBaseDir(), p));
  }

  void EnsureDir(string filePath)
  {
    if (string.IsNullOrWhiteSpace(filePath)) return;
    var dir = Path.GetDirectoryName(filePath);
    if (!string.IsNullOrWhiteSpace(dir) && !Directory.Exists(dir))
      Directory.CreateDirectory(dir);
  }

  string TimeStamp() => DateTime.Now.ToString("yyMMddHHmm");

  // NameOrder を「ツリーの見た目順」でフラット化（Paths順→Branch内順）
  List<int> FlattenNameOrder(DataTree<int> T)
  {
    var list = new List<int>();
    if (T == null || T.DataCount == 0) return list;

    for (int pi = 0; pi < T.Paths.Count; pi++)
    {
      var p = T.Paths[pi];
      var br = T.Branch(p);
      if (br == null) continue;
      for (int i = 0; i < br.Count; i++) list.Add(br[i]);
    }
    return list;
  }

  #endregion

  private void RunScript(
		DataTree<Box> B,
		DataTree<int> NameOrder,
		string pathObj,
		string path3dm,
		bool run,
		ref object okObj,
		ref object ok3dm)
  {
    okObj = "skip";
    ok3dm = "skip";
    if (!run) return;

    if (B == null || B.DataCount == 0)
    {
      okObj = "no boxes";
      ok3dm = "no boxes";
      return;
    }

    // 1) GH相対パスを解決（GHファイル基準）
    pathObj = ResolveGhRelativePath(pathObj);
    path3dm = ResolveGhRelativePath(path3dm);

    string stamp = TimeStamp();
    string baseName = "trunkVoxel"; // ★必要ならここだけ変える

    // ★NameOrder をフラット化したリスト（順番の元）
    var orderList = FlattenNameOrder(NameOrder);

    int exportedObj = 0;
    int exported3dm = 0;

    var doc = RhinoDoc.ActiveDoc;
    if (doc == null)
    {
      okObj = "no active doc";
      ok3dm = "no active doc";
      return;
    }

    // =====================================================
    // ブランチごとに書き出し
    // suffix は NameOrder の並びで決める
    // =====================================================
    for (int pi = 0; pi < B.Paths.Count; pi++)
    {
      GH_Path path = B.Paths[pi];
      var branch = B.Branch(path);
      if (branch == null || branch.Count == 0) continue;

      // ★ファイル名末尾の「3桁0埋めインデックス」
      // NameOrder が足りない場合は pi を使う
      int idx = (orderList.Count > pi) ? orderList[pi] : pi;
      string suffix = idx.ToString("D3");

      string objFile = null;
      string dmFile = null;

      // pathObj / path3dm は「フォルダ指定」を想定
      if (!string.IsNullOrWhiteSpace(pathObj))
        objFile = Path.Combine(pathObj, $"{baseName}_{stamp}_{suffix}.obj");

      if (!string.IsNullOrWhiteSpace(path3dm))
        dmFile = Path.Combine(path3dm, $"{baseName}_{stamp}_{suffix}.3dm");

      // -----------------------------
      // OBJ：Box群を Mesh 化して結合 → 書き出し
      // -----------------------------
      if (objFile != null)
      {
        EnsureDir(objFile);

        var merged = new Mesh();
        var mp = MeshingParameters.FastRenderMesh;

        foreach (var bx in branch)
        {
          if (!bx.IsValid) continue;
          var brep = bx.ToBrep();
          var meshes = Mesh.CreateFromBrep(brep, mp);
          if (meshes == null) continue;
          foreach (var m in meshes)
            if (m != null) merged.Append(m);
        }

        if (merged.Vertices.Count > 0)
        {
          merged.Normals.ComputeNormals();
          merged.Compact();

          Guid id = Guid.Empty;
          try
          {
            id = doc.Objects.AddMesh(merged);
            var w = new FileWriteOptions();
            var o = new FileObjWriteOptions(w);
            var r = FileObj.Write(objFile, doc, o);

            if (r == Rhino.PlugIns.WriteFileResult.Success)
              exportedObj++;
            else
              Print($"OBJ failed ({suffix}): {r}");
          }
          finally
          {
            if (id != Guid.Empty)
              doc.Objects.Delete(id, true);
          }
        }
        else
        {
          Print($"OBJ skipped ({suffix}): merged mesh empty");
        }
      }

      // -----------------------------
      // 3DM：Box を Extrusion として保存
      // -----------------------------
      if (dmFile != null)
      {
        EnsureDir(dmFile);
        var f = new File3dm();

        foreach (var bx in branch)
        {
          if (!bx.IsValid) continue;

          Plane pl = bx.Plane;
          Interval ix = bx.X;
          Interval iy = bx.Y;
          Interval iz = bx.Z;

          if (iz.Length <= 0) continue;

          Plane basePl = pl;
          basePl.Origin = pl.Origin + pl.ZAxis * iz.Min;

          var rect = new Rectangle3d(basePl, ix, iy);
          var crv = rect.ToNurbsCurve();

          var ex = Extrusion.Create(crv, iz.Length, true);
          if (ex != null && ex.IsValid)
            f.Objects.AddExtrusion(ex);
        }

        if (f.Objects.Count > 0)
        {
          if (f.Write(dmFile, 8)) exported3dm++;
          else Print($"3DM failed ({suffix})");
        }
        else
        {
          Print($"3DM skipped ({suffix}): no objects");
        }
      }
    }

    okObj = $"OBJ exported: {exportedObj} / branches: {B.Paths.Count} / orderCount: {orderList.Count}";
    ok3dm = $"3DM exported: {exported3dm} / branches: {B.Paths.Count} / orderCount: {orderList.Count}";
  }
}
# ---------- end c_script_8 ----------

# ==== cluster BoxSideMaker
B = ClusterInput()
debrep = DeconstructBrep(Brep=B)  # -> Faces, Edges, Vertices
area = Area(Geometry=debrep.Faces)  # -> Area, Centroid
evalsrf = EvaluateSurface(Surface=debrep.Faces, Point=area.Centroid)  # -> Point, Normal, UDirection, VDirection, Frame
abs = Absolute(Value=evalsrf.Normal)
pdecon = Deconstruct(Point=abs)  # -> XComponent, YComponent, ZComponent
smaller = SmallerThan(FirstNumber=pdecon.ZComponent, SecondNumber=0.9)  # -> SmallerThan, OrEqualTo
cull = CullPattern(List=debrep.Faces, CullPattern=smaller.SmallerThan)
join = BrepJoin(Breps=cull)  # -> Breps, Closed
B_2 = ClusterOutput(join.Breps)
