# Grasshopper definition 251213_truckVoxel.gh (Grasshopper 1.0.8)
# plug-ins: RhinoCodePluginGH, Voxelizer

c_script = CSharpScript(Dir=".\trunk\")  # -> out, Log, Path; inputs Dir: String
# ---------- c_script: C# ----------
// Grasshopper Script Instance
#region Usings
using System;
using System.IO;
using System.Linq;
using System.Collections.Generic;
using Rhino;
using Rhino.Geometry;
using Grasshopper;
using Grasshopper.Kernel;
#endregion

public class Script_Instance : GH_ScriptInstance
{
  int STABLE_CHECKS = 3;
  int STABLE_INTERVAL_MS = 200;
  int STABLE_TIMEOUT_MS = 20000;

  int _count = 0;
  HashSet<string> _processed = new HashSet<string>(StringComparer.OrdinalIgnoreCase);

  string _lastPath = null;

  private void RunScript(object x, string Dir, ref object Log, ref object Path)
  {
    _count++;

    Log = "";
    Path = _lastPath;

    // ★ 監視ディレクトリを解決
    string watchDir = ResolveDirectory(Dir);

    if (string.IsNullOrWhiteSpace(watchDir))
    {
      Log = $"[{_count}] Directory path is empty.";
      return;
    }

    if (!Directory.Exists(watchDir))
    {
      Log = $"[{_count}] Watch dir not found:\n{watchDir}";
      return;
    }

    List<string> all;
    try
    {
      all = Directory.EnumerateFiles(watchDir, "*.obj", SearchOption.TopDirectoryOnly)
                     .OrderBy(p => p, StringComparer.OrdinalIgnoreCase)
                     .ToList();
    }
    catch (Exception ex)
    {
      Log = $"[{_count}] Enumerate failed: {ex.Message}";
      return;
    }

    if (all.Count == 0)
    {
      Log = $"[{_count}] No .obj files. (polling)";
      return;
    }

    string next = all.FirstOrDefault(p => !_processed.Contains(p));
    if (next == null)
    {
      Log = $"[{_count}] No new .obj. processed={_processed.Count} total={all.Count}\nLastPath={_lastPath}";
      return;
    }

    if (!WaitUntilStableReadable(next, STABLE_CHECKS, STABLE_INTERVAL_MS, STABLE_TIMEOUT_MS))
    {
      Log = $"[{_count}] Waiting write finish...\n{next}\nLastPath={_lastPath}";
      return;
    }

    _processed.Add(next);

    _lastPath = next;
    Path = _lastPath;

    Log = $"[{_count}] New OBJ detected:\n{_lastPath}\nprocessed={_processed.Count} total={all.Count}";
  }

  // ★ Grasshopper ファイル基準で相対パスを解決
  string ResolveDirectory(string dir)
  {
    if (string.IsNullOrWhiteSpace(dir))
      return null;

    // 絶対パスならそのまま
    if (Path.IsPathRooted(dir))
      return Path.GetFullPath(dir);

    // 相対パス → Grasshopper ファイルの場所基準
    string ghPath = GrasshopperDocument?.FilePath;

    if (string.IsNullOrWhiteSpace(ghPath))
    {
      // 未保存の場合は Rhino の実行ディレクトリ基準
      return Path.GetFullPath(dir);
    }

    string ghDir = Path.GetDirectoryName(ghPath);
    return Path.GetFullPath(Path.Combine(ghDir, dir));
  }

  bool WaitUntilStableReadable(string path, int stableChecks, int intervalMs, int timeoutMs)
  {
    var start = DateTime.UtcNow;
    long lastSize = -1;
    int same = 0;

    while ((DateTime.UtcNow - start).TotalMilliseconds < timeoutMs)
    {
      try
      {
        var fi = new FileInfo(path);
        long size = fi.Length;

        using (File.Open(path, FileMode.Open, FileAccess.Read, FileShare.Read)) { }

        if (size == lastSize)
        {
          same++;
          if (same >= stableChecks) return true;
        }
        else
        {
          lastSize = size;
          same = 0;
        }
      }
      catch
      {
        same = 0;
      }

      System.Threading.Thread.Sleep(intervalMs);
    }
    return false;
  }
}
# ---------- end c_script ----------
c_script_2 = CSharpScript(P=c_script.Path)  # -> out, Meshes, Log; inputs P: String
# ---------- c_script_2: C# ----------
#region Usings
using System;
using System.IO;
using System.Linq;
using System.Collections.Generic;

using Rhino;
using Rhino.Geometry;
#endregion

public class Script_Instance : GH_ScriptInstance
{
  string _lastPath = null;

  private void RunScript(string P, ref object Meshes, ref object Log)
  {
    Meshes = null;
    Log = "";

    if (string.IsNullOrWhiteSpace(P))
    {
      Log = "No path.";
      return;
    }
    if (!File.Exists(P))
    {
      Log = "File not found:\n" + P;
      return;
    }

    // 同じパスならスキップ（必要なら削除OK）
    if (string.Equals(P, _lastPath, StringComparison.OrdinalIgnoreCase))
    {
      Log = "Same path (skip):\n" + P;
      return;
    }

    try
    {
      var mesh = LoadObjAsSingleMesh_NoRhinoDoc(P);
      Meshes = new List<Mesh>() { mesh };
      _lastPath = P;

      Log = $"Loaded OBJ as Mesh (no Rhino import)\nV={mesh.Vertices.Count} F={mesh.Faces.Count}\n{P}";
    }
    catch (Exception ex)
    {
      Log = "Load failed:\n" + ex.Message;
    }
  }

  // OBJを直接パース（v / f のみ対応）して Mesh を作る
  Mesh LoadObjAsSingleMesh_NoRhinoDoc(string path)
  {
    // 頂点
    var verts = new List<Point3d>(100000);

    // 面（頂点インデックスのみ）
    var faces = new List<int[]>(100000);

    foreach (var raw in File.ReadLines(path))
    {
      var line = raw.Trim();
      if (line.Length == 0) continue;
      if (line[0] == '#') continue;

      // vertex: v x y z
      if (line.StartsWith("v ", StringComparison.Ordinal))
      {
        // split（空白連続に耐性）
        var sp = line.Split(new[] { ' ' }, StringSplitOptions.RemoveEmptyEntries);
        if (sp.Length < 4) continue;

        // OBJは通常 float だが double で読む
        double x = ParseD(sp[1]);
        double y = ParseD(sp[2]);
        double z = ParseD(sp[3]);

        verts.Add(new Point3d(x, y, z));
        continue;
      }

      // face: f a b c [d...]
      // a は "v", "v/vt", "v//vn", "v/vt/vn" のいずれか
      if (line.StartsWith("f ", StringComparison.Ordinal))
      {
        var sp = line.Split(new[] { ' ' }, StringSplitOptions.RemoveEmptyEntries);
        if (sp.Length < 4) continue;

        // 面の頂点インデックス列（OBJは1-based、負値は末尾基準）
        var idx = new List<int>(sp.Length - 1);

        for (int i = 1; i < sp.Length; i++)
        {
          var token = sp[i];
          var vStr = token;

          int slash = token.IndexOf('/');
          if (slash >= 0) vStr = token.Substring(0, slash);

          int vi = ParseI(vStr);

          // 1-based → 0-based
          if (vi > 0) vi = vi - 1;
          // 負値は末尾基準（-1 が最後）
          else if (vi < 0) vi = verts.Count + vi;

          if (vi < 0 || vi >= verts.Count)
            throw new Exception("Face index out of range: " + token);

          idx.Add(vi);
        }

        // 三角/四角/多角形（多角形は三角形分割）
        if (idx.Count == 3)
          faces.Add(new[] { idx[0], idx[1], idx[2] });
        else if (idx.Count == 4)
          faces.Add(new[] { idx[0], idx[1], idx[2], idx[3] });
        else if (idx.Count > 4)
        {
          // fan triangulation: (0,i,i+1)
          for (int i = 1; i < idx.Count - 1; i++)
            faces.Add(new[] { idx[0], idx[i], idx[i + 1] });
        }
      }
    }

    if (verts.Count == 0) throw new Exception("No vertices found.");
    if (faces.Count == 0) throw new Exception("No faces found.");

    var m = new Mesh();

    foreach (var v in verts) m.Vertices.Add(v);

    foreach (var f in faces)
    {
      if (f.Length == 3) m.Faces.AddFace(f[0], f[1], f[2]);
      else if (f.Length == 4) m.Faces.AddFace(f[0], f[1], f[2], f[3]);
    }

    // 法線等の整備
    m.Normals.ComputeNormals();
    m.Compact();

    if (!m.IsValid) throw new Exception("Mesh invalid after build.");

    return m;
  }

  double ParseD(string s)
  {
    // ロケール対策：小数点は '.' 前提
    return double.Parse(s, System.Globalization.CultureInfo.InvariantCulture);
  }

  int ParseI(string s)
  {
    return int.Parse(s, System.Globalization.CultureInfo.InvariantCulture);
  }
}
# ---------- end c_script_2 ----------
mesh = Mesh(c_script_2.Meshes)
flooralignment = CSharpScript(M=mesh)  # -> out, FloorPlane, TiltFix, FixedMesh; inputs M: Mesh
# ---------- flooralignment: C# ----------
// Grasshopper Script Instance
#region Usings
using System;
using System.Linq;
using System.Collections;
using System.Collections.Generic;
using System.Drawing;

using Rhino;
using Rhino.Geometry;

using Grasshopper;
using Grasshopper.Kernel;
using Grasshopper.Kernel.Data;
using Grasshopper.Kernel.Types;
#endregion

public class Script_Instance : GH_ScriptInstance
{
    #region Notes
    /* 
      Members:
        RhinoDoc RhinoDocument
        GH_Document GrasshopperDocument
        IGH_Component Component
        int Iteration

      Methods (Virtual & overridable):
        Print(string text)
        Print(string format, params object[] args)
        Reflect(object obj)
        Reflect(object obj, string method_name)
    */
    #endregion

    private void RunScript(
		Mesh M,
		object maxTiltDeg,
		object distTol,
		object iters,
		object seed,
		ref object FloorPlane,
		ref object TiltFix,
		ref object FixedMesh)
    {
    FloorPlane = null;
    TiltFix = Transform.Identity;
    FixedMesh = null;

    if (M == null || M.Faces.Count == 0) return;

    // -----------------------------
    // Defaults（未接続OK）
    // -----------------------------
    double tiltDeg = 25.0;     // 上向き面の許容（床候補の法線絞り）
    double tol = 10.0;         // 距離許容（モデル単位に合わせて！）
    int maxIters = 1200;       // RANSAC反復回数
    int rngSeed = 12345;

    if (maxTiltDeg != null) { double t; if (double.TryParse(maxTiltDeg.ToString(), out t)) tiltDeg = t; }
    if (distTol    != null) { double t; if (double.TryParse(distTol.ToString(), out t)) tol = t; }
    if (iters      != null) { int t;    if (int.TryParse(iters.ToString(), out t)) maxIters = t; }
    if (seed       != null) { int t;    if (int.TryParse(seed.ToString(), out t)) rngSeed = t; }

    if (!(tiltDeg > 0)) tiltDeg = 25.0;
    if (!(tol > 0)) tol = 10.0;
    if (maxIters < 50) maxIters = 50;

    double cosThr = Math.Cos(tiltDeg * Math.PI / 180.0);
    double tol2 = tol * tol;

    // -----------------------------
    // 1) 床候補点を作る（上向き面の中心）
    //    FaceNormalsは使わず自前で法線計算（安全）
    // -----------------------------
    const int MAX_SAMPLES = 12000;
    int stride = Math.Max(1, M.Faces.Count / MAX_SAMPLES);

    var pts = new List<Point3d>(Math.Min(M.Faces.Count / stride, MAX_SAMPLES));

    for (int fi = 0; fi < M.Faces.Count; fi += stride)
    {
        MeshFace f = M.Faces[fi];

        Point3d p0 = M.Vertices[f.A];
        Point3d p1 = M.Vertices[f.B];
        Point3d p2 = M.Vertices[f.C];
        Point3d p3 = f.IsQuad ? (Point3d)M.Vertices[f.D] : Point3d.Unset;

        // center
        Point3d c = f.IsQuad
        ? new Point3d((p0.X+p1.X+p2.X+p3.X)/4.0, (p0.Y+p1.Y+p2.Y+p3.Y)/4.0, (p0.Z+p1.Z+p2.Z+p3.Z)/4.0)
        : new Point3d((p0.X+p1.X+p2.X)/3.0, (p0.Y+p1.Y+p2.Y)/3.0, (p0.Z+p1.Z+p2.Z)/3.0);

        // normal（自前）
        Vector3d n = Vector3d.CrossProduct(p1 - p0, p2 - p0);
        if (f.IsQuad)
        {
        Vector3d n2 = Vector3d.CrossProduct(p3 - p2, p0 - p2);
        n += n2;
        }
        if (!n.IsValid || n.IsZero) continue;
        n.Unitize();

        // 上向きだけ
        if (n.Z < cosThr) continue;

        pts.Add(c);
    }

    if (pts.Count < 50) return; // 床候補が少なすぎる

    // -----------------------------
    // 2) RANSAC：平面推定
    // -----------------------------
    var rng = new Random(rngSeed);

    Plane bestPlane = Plane.Unset;
    int bestInliers = 0;

    // 早期終了閾値（十分な割合のinlierが取れたら終える）
    double earlyRatio = 0.65; // 65%が同一平面なら十分とみなす
    int earlyInliers = (int)(pts.Count * earlyRatio);

    // 3点で平面生成→inlier数を評価
    for (int it = 0; it < maxIters; it++)
    {
        // ランダムに異なる3点
        int i0 = rng.Next(pts.Count);
        int i1 = rng.Next(pts.Count);
        int i2 = rng.Next(pts.Count);
        if (i1 == i0 || i2 == i0 || i2 == i1) { it--; continue; }

        Point3d a = pts[i0];
        Point3d b = pts[i1];
        Point3d c = pts[i2];

        // 共線回避（面積が小さい三角形はスキップ）
        Vector3d ab = b - a;
        Vector3d ac = c - a;
        Vector3d cross = Vector3d.CrossProduct(ab, ac);
        if (!cross.IsValid || cross.Length < 1e-9) { it--; continue; }

        Plane pl = new Plane(a, b, c);
        if (!pl.IsValid) { it--; continue; }

        // 上向き（床）に寄せる：法線Zが負なら反転
        if (pl.Normal.Z < 0) pl.Flip();

        // inlier数カウント（点→平面距離）
        int inliers = 0;
        for (int k = 0; k < pts.Count; k++)
        {
        double d = pl.DistanceTo(pts[k]); // signed
        if (d < 0) d = -d;
        if (d <= tol) inliers++;
        }

        if (inliers > bestInliers)
        {
        bestInliers = inliers;
        bestPlane = pl;

        if (bestInliers >= earlyInliers) break; // 早期終了
        }
    }

    if (bestInliers < 10 || !bestPlane.IsValid) return;

    // -----------------------------
    // 3) bestPlane の inlier だけで最小二乗フィットで精密化
    // -----------------------------
    var inlierPts = new List<Point3d>(bestInliers);
    for (int k = 0; k < pts.Count; k++)
    {
        double d = bestPlane.DistanceTo(pts[k]);
        if (d < 0) d = -d;
        if (d <= tol) inlierPts.Add(pts[k]);
    }

    Plane refined;
    if (Plane.FitPlaneToPoints(inlierPts, out refined) != PlaneFitResult.Success)
        refined = bestPlane;

    if (refined.Normal.Z < 0) refined.Flip();

    // -----------------------------
    // 4) 平面法線 -> WorldZ へ回転（傾き補正）
    // -----------------------------
    Vector3d from = refined.Normal;
    if (!from.Unitize()) return;

    Vector3d to = Vector3d.ZAxis;

    Vector3d rotAxis = Vector3d.CrossProduct(from, to);
    double rotAxisLen = rotAxis.Length;
    double angle = Vector3d.VectorAngle(from, to);

    Transform tFix = Transform.Identity;
    if (rotAxisLen > 1e-9 && angle > 1e-9)
    {
        rotAxis /= rotAxisLen;
        tFix = Transform.Rotation(angle, rotAxis, refined.Origin);
    }

    Mesh fixedMesh = M.DuplicateMesh();
    fixedMesh.Transform(tFix);

    FloorPlane = refined;
    TiltFix = tFix;
    FixedMesh = fixedMesh;
    }
}
# ---------- end flooralignment ----------
mesh_2 = Mesh(flooralignment.FixedMesh)
orientxy = CSharpScript(M=mesh_2)  # -> out, YawDeg, AxisXY; inputs M: Mesh
# ---------- orientxy: C# ----------
// Grasshopper Script Instance
#region Usings
using System;
using System.Linq;
using System.Collections;
using System.Collections.Generic;
using System.Drawing;

using Rhino;
using Rhino.Geometry;

using Grasshopper;
using Grasshopper.Kernel;
using Grasshopper.Kernel.Data;
using Grasshopper.Kernel.Types;
#endregion

public class Script_Instance : GH_ScriptInstance
{
    #region Notes
    /* 
      Members:
        RhinoDoc RhinoDocument
        GH_Document GrasshopperDocument
        IGH_Component Component
        int Iteration

      Methods (Virtual & overridable):
        Print(string text)
        Print(string format, params object[] args)
        Reflect(object obj)
        Reflect(object obj, string method_name)
    */
    #endregion

    private void RunScript(
		Mesh M,
		object BinDeg,
		object MinLen,
		ref object YawDeg,
		ref object AxisXY)
    {
    // --- 入力のデフォルト ---
    double binDeg = 2.0;   // 角度ビン幅（度）
    double minLen = 1e-6;  // 最小エッジ長

    if (BinDeg != null)
    {
        double t;
        if (double.TryParse(BinDeg.ToString(), out t)) binDeg = t;
    }
    if (MinLen != null)
    {
        double t;
        if (double.TryParse(MinLen.ToString(), out t)) minLen = t;
    }

    if (binDeg <= 0.1) binDeg = 2.0;
    if (minLen <= 0.0) minLen = 1e-6;

    // --- 出力の初期化 ---
    double yaw = double.NaN;
    Vector3d axis = Vector3d.Unset;

    if (M == null || M.Vertices.Count < 2)
    {
        YawDeg = yaw;
        AxisXY = axis;
        return;
    }

    var te = M.TopologyEdges;
    int edgeCount = te.Count;
    if (edgeCount == 0)
    {
        YawDeg = yaw;
        AxisXY = axis;
        return;
    }

    int bins = (int)Math.Ceiling(90.0 / binDeg);
    double[] hist = new double[bins];

    for (int ei = 0; ei < edgeCount; ei++)
    {
        Line e = te.EdgeLine(ei);
        Vector3d v = e.Direction;

        v.Z = 0.0;
        double len = v.Length;
        if (len < minLen) continue;

        v /= len;

        double a = Math.Atan2(v.Y, v.X) * 180.0 / Math.PI;
        if (a < 0) a += 180.0;
        if (a >= 90.0) a -= 90.0;

        int bi = (int)Math.Floor(a / binDeg);
        bi = Math.Max(0, Math.Min(bins - 1, bi));

        hist[bi] += len; // 長いエッジほど重み
    }

    int best = 0;
    double bestVal = hist[0];
    for (int i = 1; i < bins; i++)
    {
        if (hist[i] > bestVal) { bestVal = hist[i]; best = i; }
    }

    yaw = (best + 0.5) * binDeg;

    double rad = yaw * Math.PI / 180.0;
    axis = new Vector3d(Math.Cos(rad), Math.Sin(rad), 0.0);
    axis.Unitize();

    YawDeg = yaw;
    AxisXY = axis;
    }

}
# ---------- end orientxy ----------
X = UnitX(Factor=1)
angle = Angle(VectorA=X, VectorB=orientxy.AxisXY)  # -> Angle, Reflex
rotate = Rotate(Geometry=mesh_2, Angle=angle.Reflex, Plane=PlaneXY(0, 0, 0))  # -> Geometry, Transform
mesh_3 = Mesh(rotate.Geometry)
wrap = ShrinkWrap(Geometry=mesh_3, Offset=0, Smoothing=0, Optimization=10, FillHoles=True)
scale = Scale(Geometry=wrap, Center=Point(0, 0, 0), Factor=Slider(1000, range=0..1000))  # -> Geometry, Transform
voxelizer = Voxelizer(Mesh=scale.Geometry, Size=Slider(1000, range=10..1000))  # -> Voxels, Points
c_script_3 = CSharpScript(B=voxelizer.Voxels)  # -> out, DupIdx, Groups, Unique; inputs B: list of Box, Tol: Double
# ---------- c_script_3: C# ----------
// Grasshopper Script Instance
#region Usings
using System;
using System.Linq;
using System.Collections;
using System.Collections.Generic;
using System.Drawing;

using Rhino;
using Rhino.Geometry;

using Grasshopper;
using Grasshopper.Kernel;
using Grasshopper.Kernel.Data;
using Grasshopper.Kernel.Types;
#endregion

public class Script_Instance : GH_ScriptInstance
{
    #region Notes
    /* 
      Members:
        RhinoDoc RhinoDocument
        GH_Document GrasshopperDocument
        IGH_Component Component
        int Iteration

      Methods (Virtual & overridable):
        Print(string text)
        Print(string format, params object[] args)
        Reflect(object obj)
        Reflect(object obj, string method_name)
    */
    #endregion

    private void RunScript(
		List<Box> B,
		double Tol,
		ref object DupIdx,
		ref object Groups,
		ref object Unique)
    {
    if (B == null) { DupIdx = new List<int>(); Groups = new DataTree<int>(); Unique = new List<Box>(); return; }
    if (Tol <= 0) Tol = 1e-6;

    long Q(double v) => (long)Math.Round(v / Tol);

    // key: bbox(min,max) を tolerance で量子化
    string Key(Box box)
    {
        var bb = box.BoundingBox;
        var mn = bb.Min;
        var mx = bb.Max;
        return string.Join("_", new long[]{
        Q(mn.X), Q(mn.Y), Q(mn.Z),
        Q(mx.X), Q(mx.Y), Q(mx.Z)
        });
    }

    var dict = new Dictionary<string, List<int>>();
    for (int i = 0; i < B.Count; i++)
    {
        var k = Key(B[i]);
        if (!dict.TryGetValue(k, out var list))
        {
        list = new List<int>();
        dict[k] = list;
        }
        list.Add(i);
    }

    var dupIdx = new List<int>();
    var groups = new DataTree<int>();
    var unique = new List<Box>();

    int gi = 0;
    foreach (var kv in dict)
    {
        var idxs = kv.Value;
        // グループ出力
        var path = new GH_Path(gi++);
        foreach (var id in idxs) groups.Add(id, path);

        // unique は先頭だけ採用
        unique.Add(B[idxs[0]]);

        // 2個目以降は重複として列挙
        for (int j = 1; j < idxs.Count; j++) dupIdx.Add(idxs[j]);
    }

    DupIdx = dupIdx;
    Groups = groups;
    Unique = unique;
    }
}
# ---------- end c_script_3 ----------
c_script_4 = CSharpScript(B=c_script_3.Unique, pathObj=".\voxels\", path3dm=".\voxels\", run=Toggle(True))  # -> out, okObj, ok3dm; inputs B: tree of Box, pathObj: String, path3dm: String, run: Boolean
# ---------- c_script_4: C# ----------
// Grasshopper Script Instance
#region Usings
using System;
using System.Linq;
using System.Collections;
using System.Collections.Generic;
using System.Drawing;
using System.IO;

using Rhino;
using Rhino.Geometry;
using Rhino.FileIO;

using Grasshopper;
using Grasshopper.Kernel;
using Grasshopper.Kernel.Data;
using Grasshopper.Kernel.Types;
#endregion

public class Script_Instance : GH_ScriptInstance
{
    #region Notes
    /* 
      Members:
        RhinoDoc RhinoDocument
        GH_Document GrasshopperDocument
        IGH_Component Component
        int Iteration

      Methods (Virtual & overridable):
        Print(string text)
        Print(string format, params object[] args)
        Reflect(object obj)
        Reflect(object obj, string method_name)
    */
    #endregion

   string NormalizePath(string p, string defaultName)
    {
        if (string.IsNullOrWhiteSpace(p)) return null;

        // フォルダだけ来た場合 or 拡張子が無い場合 → デフォルト名を付与
        if (p.EndsWith("\\") || string.IsNullOrEmpty(Path.GetExtension(p)))
        p = Path.Combine(p.TrimEnd('\\'), defaultName);

        return p;
    }

    string NormalizePathWithTimestamp(string p, string baseName, string ext)
    {
    if (string.IsNullOrWhiteSpace(p)) return null;

    string stamp = DateTime.Now.ToString("yyMMddHHmm");

    // フォルダのみ指定
    if (p.EndsWith("\\"))
    {
        return Path.Combine(p.TrimEnd('\\'), $"{baseName}_{stamp}{ext}");
    }

    // ファイル名あり
    string dir  = Path.GetDirectoryName(p);
    string name = Path.GetFileNameWithoutExtension(p);
    string e    = Path.GetExtension(p);

    if (string.IsNullOrEmpty(e))
        e = ext;

    return Path.Combine(dir, $"{name}_{stamp}{e}");
    }


    string GetGhBaseDir()
    {
    // GHファイルが保存されているフォルダ
    var ghPath = GrasshopperDocument != null ? GrasshopperDocument.FilePath : null;

    if (!string.IsNullOrWhiteSpace(ghPath))
        return Path.GetDirectoryName(ghPath);

    // 未保存のときの退避先（任意で変更OK）
    return Environment.GetFolderPath(Environment.SpecialFolder.DesktopDirectory);
    }

    string ResolveGhRelativePath(string p)
    {
    if (string.IsNullOrWhiteSpace(p)) return null;

    // すでに絶対パスならそのまま
    if (Path.IsPathRooted(p)) return p;

    // GHファイル位置を基準に絶対パスへ
    string baseDir = GetGhBaseDir();
    return Path.GetFullPath(Path.Combine(baseDir, p));
    }


    void EnsureDir(string filePath)
    {
        if (string.IsNullOrWhiteSpace(filePath)) return;
        var dir = Path.GetDirectoryName(filePath);
        if (!string.IsNullOrWhiteSpace(dir) && !Directory.Exists(dir))
        Directory.CreateDirectory(dir);
    }

    private void RunScript(
		DataTree<Box> B,
		string pathObj,
		string path3dm,
		bool run,
		ref object okObj,
		ref object ok3dm)
    {
        okObj = "skip";
        ok3dm = "skip";
        if (!run) return;
        if (B == null || B.DataCount == 0)
        {
        okObj = "no boxes";
        ok3dm = "no boxes";
        return;
        }

        // 1) GH相対パスを解決（GHファイル基準）
        pathObj = ResolveGhRelativePath(pathObj);
        path3dm = ResolveGhRelativePath(path3dm);

        // 2) 日時サフィックスを付ける（フォルダ指定でもOK）
        pathObj = NormalizePathWithTimestamp(pathObj, "trunkVoxel", ".obj");
        path3dm = NormalizePathWithTimestamp(path3dm, "trunkVoxel", ".3dm");

        // Tree内のBoxを全部集める
        var boxes = new List<Box>(B.DataCount);
        foreach (var p in B.Paths)
        {
        var br = B.Branch(p);
        if (br == null) continue;
        for (int i = 0; i < br.Count; i++)
            if (br[i].IsValid) boxes.Add(br[i]);
        }
        if (boxes.Count == 0)
        {
        okObj = "no valid boxes";
        ok3dm = "no valid boxes";
        return;
        }

        // -------------------------
        // OBJ：Mesh化して1つに結合
        // -------------------------
        if (!string.IsNullOrWhiteSpace(pathObj))
        {
        EnsureDir(pathObj);

        var merged = new Mesh();
        var mp = MeshingParameters.FastRenderMesh;

        foreach (var bx in boxes)
        {
            var brep = bx.ToBrep();
            var meshes = Mesh.CreateFromBrep(brep, mp);
            if (meshes == null) continue;
            foreach (var m in meshes)
            if (m != null) merged.Append(m);
        }

        merged.Normals.ComputeNormals();
        merged.Compact();

        var doc = RhinoDoc.ActiveDoc;
        if (doc == null)
        {
            okObj = "no active doc";
        }
        else
        {
            Guid id = Guid.Empty;
            try
            {
            id = doc.Objects.AddMesh(merged);
            if (id == Guid.Empty)
            {
                okObj = "AddMesh failed";
            }
            else
            {
                var w = new FileWriteOptions();
                var o = new FileObjWriteOptions(w);
                var r = FileObj.Write(pathObj, doc, o);
                okObj = (r == Rhino.PlugIns.WriteFileResult.Success) ? "OBJ exported" : ("OBJ failed: " + r.ToString());
            }
            }
            finally
            {
            if (id != Guid.Empty) doc.Objects.Delete(id, true);
            }
        }
        }

        // -------------------------
        // 3DM：Boxを「Extrusion（押し出し）」として保存（Brep化しない）
        // -------------------------
        if (!string.IsNullOrWhiteSpace(path3dm))
        {
        EnsureDir(path3dm);

        var f = new File3dm();

        foreach (var bx in boxes)
        {
            if (!bx.IsValid) continue;

            // Boxの平面と寸法
            Plane pl = bx.Plane;
            Interval ix = bx.X;
            Interval iy = bx.Y;
            Interval iz = bx.Z;

            double zMin = iz.Min;
            double zLen = iz.Length;
            if (zLen <= 0) continue;

            // 断面矩形（Boxの底面）を zMin 位置に作る
            Plane basePl = pl;
            basePl.Origin = pl.Origin + pl.ZAxis * zMin;

            var rect = new Rectangle3d(basePl, ix, iy);
            Curve profile = rect.ToNurbsCurve(); // 平面曲線

            // 押し出し（cap=true でソリッド）
            var ex = Extrusion.Create(profile, zLen, true);
            if (ex == null || !ex.IsValid) continue;

            // 3dmへ追加（Extrusionのまま保存される）
            f.Objects.AddExtrusion(ex);
        }

        bool ok = f.Write(path3dm, 8);
        ok3dm = ok ? "3DM exported (Extrusion)" : "3DM failed";
        }
    }
}
# ---------- end c_script_4 ----------
panel = Panel(c_script_4.out)
